# Grasshopper definition SimpleFrixelStructure.gh (Grasshopper 1.0.5)

number_slider = Slider(5.01, range=0..10)
c_script = CSharpScript(
    amp=Slider(1804, range=0..10000),
    Reference=["C:\Users\epoulsen\Documents\GitHub\frixel\Frixel.Optimizer\bin\Debug\Frixel.Core.dll", "C:\Users\epoulsen\Documents\GitHub\frixel\Frixel.Optimizer\bin\Debug\Frixel.Optimizer.dll", "C:\Users\epoulsen\Documents\GitHub\frixel\Frixel.Optimizer\bin\Debug\GeneticSharp.Domain.dll", "C:\Users\epoulsen\Documents\GitHub\frixel\Frixel.Optimizer\bin\Debug\GeneticSharp.Extensions.dll", "C:\Users\epoulsen\Documents\GitHub\frixel\Frixel.Optimizer\bin\Debug\GeneticSharp.Infrastructure.Framework.dll", "C:\Users\epoulsen\Documents\GitHub\frixel\Frixel.Optimizer\bin\Debug\GeneticSharp.Infrastructure.Threading.dll", "C:\Users\epoulsen\Documents\GitHub\frixel\Frixel.Optimizer\bin\Debug\MathNet.Numerics.dll", "C:\Users\epoulsen\Documents\GitHub\frixel\Frixel.Optimizer\bin\Debug\NCalc.dll", "C:\Users\epoulsen\Documents\GitHub\frixel\Frixel.Optimizer\bin\Debug\SharpFE.Core.dll", "C:\Users\epoulsen\Documents\GitHub\frixel\Frixel.Optimizer\bin\Debug\SmartThreadPool.dll"])  # -> out, A, B; inputs amp: Double
# ---------- c_script: C# ----------
    var pixStruct = Frixel.Core.ModelCreator.CreatePixelStructure();
    pixStruct.WindLoad.Direction = new Frixel.Core.Geometry.Point2d(amp, 0);

    FrixelAnalyzer analyzer = new FrixelAnalyzer();
    AnalysisResults results = analyzer.Analyze(pixStruct);



    List<Point3d> pts = new List<Point3d>();
    List<Line> lines = new List<Line>();
    int i = 0;
    foreach (var node in pixStruct.Nodes)
    {
      double dispX = results.NodeResults[i].DispX;
      double dispY = results.NodeResults[i].DispY;

      pts.Add(new Point3d(node.X + dispX, 0, node.Y + dispY));
      i++;
    }

    foreach (Edge edge in pixStruct.Edges)
    {
      lines.Add(new Line(pts[edge.Start], pts[edge.End]));
    }

    foreach (Pixel pix in pixStruct.Pixels)
    {
      List<Edge> braces = pix.GetBracing();

      foreach (Edge brace in braces)
      {
        lines.Add(new Line(pts[brace.Start], pts[brace.End]));
      }
    }

    A = pts;
    B = lines;
# ---------- end c_script ----------
